# Grasshopper definition NODEMaple Grasshopper.gh (Grasshopper 1.0.9)

nodemaple_materials = Python3Script()  # -> materials, debug
#   port debug: Materials defined in NODEMaple
# ---------- nodemaple_materials: Python ----------
"""
NODEMaple Materials — Level 1
Queries the list of available materials from the NODE Maple library.

Requires:
  - Maple installed locally (default: Maple 2026)
  - NODE Library packages installed via PackageTools

Output:
  materials : list of material names, e.g. ["steel", "timber", "concrete"]
  debug     : raw Maple output for troubleshooting
"""
import os
import subprocess

# ---------------------------------------------------------------------------
# Configuration
# ---------------------------------------------------------------------------
# Maple version, overridable via GH input or the MAPLE environment variable.
# The environment variable takes precedence since it points to a concrete
# installation (e.g. "C:\Program Files\Maple 2026").
if os.environ.get("MAPLE"):
    MAPLE_ROOT = os.environ["MAPLE"]
else:
    MAPLE_ROOT = os.path.join(r"C:\Program Files", f"Maple {maple_version}")

MAPLE_EXE = os.path.join(MAPLE_ROOT, "bin.X86_64_WINDOWS", "cmaple.exe")


def run_maple_script(script, timeout=20):
    """Run a Maple script in a fresh cmaple process and return its output.

    Starts cmaple in quiet mode (-q), feeds the script via stdin and
    collects everything written to stdout/stderr. Failures surface in
    the returned text rather than crashing Rhino.
    """
    env = dict(os.environ)
    env["MAPLE"] = MAPLE_ROOT
    # Ensure Maple's binaries are found from the subprocess on any host.
    env["PATH"] = os.path.join(MAPLE_ROOT, "bin.X86_64_WINDOWS") + \
        os.pathsep + env.get("PATH", "")

    proc = subprocess.Popen(
        [MAPLE_EXE, "-q"],
        stdin=subprocess.PIPE,
        stdout=subprocess.PIPE,
        stderr=subprocess.STDOUT,
        text=True,
        cwd=os.path.join(MAPLE_ROOT, "bin.X86_64_WINDOWS"),
        env=env,
        creationflags=subprocess.CREATE_NO_WINDOW)

    out, _ = proc.communicate(input=script, timeout=timeout)
    return out


def get_material_list():
    """Query NODEFunctions:-Materials() and return the parseable script.

    NODE modules are auto-loaded from the user's Maple toolbox
    (installed via PackageTools), so no with() call is required.
    """
    script = (
        "kernelopts(printbytes=false):\n"
        "interface(prettyprint=0):\n"
        "matlist := NODEFunctions:-Materials():\n"
        "for m in matlist do\n"
        '    printf("MAT|%s\\n", m)\n'
        "end do:\n"
        "quit:\n"
    )
    return run_maple_script(script)


# ---------------------------------------------------------------------------
# Main execution
# ---------------------------------------------------------------------------
raw = get_material_list()

materials = []
for line in raw.splitlines():
    s = line.strip()
    if s.startswith("MAT|"):
        name = s.split("|", 1)[1].strip().strip('"')
        if name:
            materials.append(name)

debug = raw  # full Maple output for troubleshooting
# ---------- end nodemaple_materials ----------
panel = Panel(nodemaple_materials.materials)
panel_2 = Panel(nodemaple_materials.debug)
nodemaple_material_types_2b = Python3Script()  # -> members, steel, timber, concrete, debug
#   port steel: Specific material qualities defined for chosen material
# ---------- nodemaple_material_types_2b: Python ----------
"""
NODEMaple Material Types — Level 2b (dynamic categories)
Enumerates all material categories and their specific grades in a single
Maple process.

The category list is queried at runtime via NODEFunctions:-Materials(), so
categories added to the NODE library appear automatically. Only the
category -> module mapping is explicit, since Maple provides no documented
way to enumerate module names.

Output:
  members : dict, e.g. {"steel": ["S 235", ...], "timber": [...], ...}
  steel   : list of steel grades
  timber  : list of timber grades
  concrete: list of concrete grades
  debug   : raw Maple output for troubleshooting
"""
import os
import subprocess

# ---------------------------------------------------------------------------
# Configuration
# ---------------------------------------------------------------------------
if os.environ.get("MAPLE"):
    MAPLE_ROOT = os.environ["MAPLE"]
else:
    MAPLE_ROOT = os.path.join(r"C:\Program Files", f"Maple {maple_version}")

MAPLE_EXE = os.path.join(MAPLE_ROOT, "bin.X86_64_WINDOWS", "cmaple.exe")

def run_maple_script(script, timeout=30):
    """Run a Maple script in a fresh cmaple process and return its output."""
    env = dict(os.environ)
    env["MAPLE"] = MAPLE_ROOT
    env["PATH"] = os.path.join(MAPLE_ROOT, "bin.X86_64_WINDOWS") + \
        os.pathsep + env.get("PATH", "")

    proc = subprocess.Popen(
        [MAPLE_EXE, "-q"],
        stdin=subprocess.PIPE, stdout=subprocess.PIPE,
        stderr=subprocess.STDOUT, text=True,
        cwd=os.path.join(MAPLE_ROOT, "bin.X86_64_WINDOWS"),
        env=env,
        creationflags=subprocess.CREATE_NO_WINDOW)

    out, _ = proc.communicate(input=script, timeout=timeout)
    return out

def get_all_member_lists():
    """Query grade lists for all categories reported by NODE in one process.

    Emits one tagged line per grade:  MEM|<category>|<grade>
    Categories without a module mapping are reported as:  SKIP|<category>
    """
    script_lines = [
        "kernelopts(printbytes=false):",
        "interface(prettyprint=0):",
        "# Category -> module mapping. Extend this table when new NODE",
        "# material packages are installed.",
        "# NOTE: avoid names like 'mods'/'mod' - they are protected in Maple.",
        'nodetab := table(["steel"    = NODESteelMaterial,',
        '                  "timber"   = NODETimberMaterial,',
        '                  "concrete" = NODEConcreteMaterial]):',
        "# Categories are discovered at runtime, not hard-coded.",
        "cats := NODEFunctions:-Materials():",
        "known := [indices(nodetab, 'nolist')]:",
        "for c in cats do",
        "  if member(c, known) then",
        "    M := nodetab[c]:",
        '    mem := M:-Property("allmembers"):',
        "    for m in mem do",
        '      printf("MEM|%s|%s\\n", c, m)',
        "    end do:",
        "  else",
        '    printf("SKIP|%s\\n", c)',
        "  end if:",
        "end do:",
        "quit:",
    ]
    return run_maple_script("\n".join(script_lines) + "\n")

# ---------------------------------------------------------------------------
# Main execution
# ---------------------------------------------------------------------------
raw = get_all_member_lists()

members = {}    # {"steel": [...], "timber": [...], "concrete": [...]}
for line in raw.splitlines():
    s = line.strip()
    if s.startswith("MEM|"):
        # Split into 3 parts max: prefix, category, grade name.
        # Grade names contain spaces and slashes ("S 275 N/NL"), so the
        # grade itself must never be split further.
        parts = s.split("|", 2)
        if len(parts) == 3:
            _, cat, name = parts
            name = name.strip().strip('"')
            if name:
                members.setdefault(cat, []).append(name)

# Convenience outputs for direct wiring (avoids dict lookups on canvas).
steel = members.get("steel", [])
timber = members.get("timber", [])
concrete = members.get("concrete", [])

debug = raw  # full Maple output; also shows any SKIP|<category> lines
# ---------- end nodemaple_material_types_2b ----------
list_item = ListItem(List=nodemaple_materials.materials, Index=Slider(1, range=0..2), Wrap=True)
panel_3 = Panel(nodemaple_material_types_2b.members)
panel_4 = Panel(nodemaple_material_types_2b.steel)
panel_5 = Panel(nodemaple_material_types_2b.timber)
nodemaple_material_types_2a = Python3Script(material=list_item)  # -> members, debug
#   port members: Specific material qualities defined for chosen material
# ---------- nodemaple_material_types_2a: Python ----------
"""
NODEMaple Material Members — Level 2
Queries the list of specific material grades for a given material category.

Input:
  material : category name from Level 1, e.g. "steel" | "timber" | "concrete"

Output:
  members : list of grade names, e.g. ["C14", "C16", ..., "GL 32h"]
  debug   : raw Maple output for troubleshooting
"""
import os
import subprocess

# ---------------------------------------------------------------------------
# Configuration (same backbone as Level 1)
# ---------------------------------------------------------------------------
if os.environ.get("MAPLE"):
    MAPLE_ROOT = os.environ["MAPLE"]
else:
    MAPLE_ROOT = os.path.join(r"C:\Program Files", f"Maple {maple_version}")

MAPLE_EXE = os.path.join(MAPLE_ROOT, "bin.X86_64_WINDOWS", "cmaple.exe")

def run_maple_script(script, timeout=20):
    """Run a Maple script in a fresh cmaple process and return its output."""
    env = dict(os.environ)
    env["MAPLE"] = MAPLE_ROOT
    env["PATH"] = os.path.join(MAPLE_ROOT, "bin.X86_64_WINDOWS") + \
        os.pathsep + env.get("PATH", "")

    proc = subprocess.Popen(
        [MAPLE_EXE, "-q"],
        stdin=subprocess.PIPE, stdout=subprocess.PIPE,
        stderr=subprocess.STDOUT, text=True,
        cwd=os.path.join(MAPLE_ROOT, "bin.X86_64_WINDOWS"),
        env=env,
        creationflags=subprocess.CREATE_NO_WINDOW)

    out, _ = proc.communicate(input=script, timeout=timeout)
    return out

def category_to_module(category):
    """Map a Level 1 category to the corresponding Maple module name.

    "timber" -> "NODETimberMaterial", "steel" -> "NODESteelMaterial", ...
    """
    return "NODE" + category.capitalize() + "Material"

def get_member_list(module_name):
    """Query <module>:-Property("allmembers") and emit parseable output."""
    script = (
        "kernelopts(printbytes=false):\n"
        "interface(prettyprint=0):\n"
        f"M := parse(\"{module_name}\"):\n"
        "mem := M:-Property(\"allmembers\"):\n"
        "for m in mem do\n"
        '    printf("MEM|%s\\n", m)\n'
        "end do:\n"
        "quit:\n"
    )
    return run_maple_script(script)

# ---------------------------------------------------------------------------
# Main execution
# ---------------------------------------------------------------------------
module_name = category_to_module(str(material).strip().lower())

if module_name not in ("NODESteelMaterial", "NODEConcreteMaterial",
                       "NODETimberMaterial"):
    members = []
    debug = f"Unknown material category: {material!r} — " \
            "expected 'steel', 'timber' or 'concrete'."
else:
    raw = get_member_list(module_name)

    members = []
    for line in raw.splitlines():
        s = line.strip()
        if s.startswith("MEM|"):
            # Grade names contain spaces and slashes ("S 275 N/NL"),
            # so split only once and keep the rest intact.
            name = s.split("|", 1)[1].strip().strip('"')
            if name:
                members.append(name)

    debug = raw
# ---------- end nodemaple_material_types_2a ----------
panel_6 = Panel(nodemaple_material_types_2b.debug)
panel_7 = Panel(nodemaple_material_types_2b.concrete)
panel_8 = Panel(list_item)
panel_9 = Panel(nodemaple_material_types_2a.members)
panel_10 = Panel(nodemaple_material_types_2a.debug)
timber_properties = Python3Script(material="C24", prop="f_m,k")  # -> out, value, unit, debug
# ---------- timber_properties: Python ----------
"""NODE-Timber-Materialabfrage, parametrisiert"""
import os, subprocess

MAPLE_PATH = r"C:\Program Files\Maple 2026\bin.X86_64_WINDOWS\cmaple.exe"
MAPLE_ROOT = r"C:\Program Files\Maple 2026"

def timber_property(material, prop):
    maple_dir = os.path.dirname(MAPLE_PATH)
    env = dict(os.environ)
    env["PATH"] = maple_dir + os.pathsep + env.get("PATH", "")
    env["MAPLE"] = MAPLE_ROOT

    script = (
        'with(NODETimberMaterial):\n'
        'kernelopts(printbytes=false):\n'
        'interface(prettyprint=0):\n'
        f'p := Property("{material}", "{prop}"):\n'
        'q := Units:-Split(p):\n'
        'printf("VALUE=%a\\n", evalf(q[1])):\n'
        'printf("UNIT=%a\\n", q[2]):\n'
        'quit:\n'
    )

    proc = subprocess.Popen(
        [MAPLE_PATH, "-q"],
        stdin=subprocess.PIPE, stdout=subprocess.PIPE,
        stderr=subprocess.STDOUT, text=True,
        cwd=maple_dir, env=env,
        creationflags=subprocess.CREATE_NO_WINDOW)

    out, _ = proc.communicate(input=script, timeout=20)
    return out

# ---- Eingaben ----
raw = timber_property(material, prop)

value = None
unit  = None
parsed = []                      # Diagnose: was wurde erkannt?

for line in raw.splitlines():
    s = line.strip()
    parsed.append(repr(s))        # Zeile 1:1 mit Sonderzeichen sichtbar
    if s.startswith("VALUE="):
        try:
            value = float(s.split("=", 1)[1])
            parsed.append(f"  -> value = {value!r}")
        except ValueError as e:
            parsed.append(f"  !! float-Fehler: {e}")
    elif s.startswith("UNIT="):
        unit = s.split("=", 1)[1]
        parsed.append(f"  -> unit = {unit!r}")

debug = "\n".join(parsed)
# ---------- end timber_properties ----------
panel_11 = Panel(timber_properties.unit)
panel_12 = Panel(timber_properties.out)
panel_13 = Panel(timber_properties.value)
panel_14 = Panel(timber_properties.debug)
